# Grasshopper definition CustomType with Mesh.gh (Grasshopper 0.9.76)
# plug-ins: BH.UI.Grasshopper

# Custom Type with Mesh
panel = Panel("Material")
createcustom = CreateCustom(Type=panel, MaterialName="Clay", Component="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")
createcustom_2 = CreateCustom(Type=panel, MaterialName="Wood", Component="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")
conmesh = ConstructMesh(Vertices=[Point(0, 0, 0), Point(10, 0, 0), Point(10, 10, 0), Point(0, 10, 0)], Faces={A=0, B=1, C=2, D=3})

localrepositorysettings = LocalRepositorySettings(
    GitRootPath="C:\Users\alombardi\GitHub",
    CacheRootPath="C:\ProgramData",
    CacheFileName_RepositoryAllFilePaths="cached_RepositoryAllFilePaths.txt",
    CacheFileName_PropertyInfoFileLines="cached_PropertyInfoFileLines.txt",
    GithubOrganisationURL="https://github.com/BHoM/",
    ReadCacheFiles=True,
    WriteCacheFiles=False,
    Component="BH.oM.RDF.LocalRepositorySettings")
ontologysettings = OntologySettings(
    OntologyTitle="220627-081902_newBHoMOntology",
    OntologyDescription="New BHoM ontology",
    OntologyBaseAddress="http://visualdataweb.org/",
    TBoxSettings="{ \"_t\" : \"BH.oM.RDF.TBoxSettings\", \"CustomObjectTypesBaseAddress\" : \"http://customizeMeFrom-OntologySettings.TBoxSettings.CustomObjectTypesBaseAddress\", \"TreatCustomObjectsWithTypeKeyAsCustomObjectTypes\" : true, \"CustomobjectsTypeKey\" : \"Type\", \"_bhomVersion\" : \"5.2\" }",
    ABoxSettings="{ \"_t\" : \"BH.oM.RDF.ABoxSettings\", \"IndividualsBaseAddress\" : \"http://customizeMeFrom-OntologySettings.ABoxSettings.IndividualsBaseAddress\", \"ConsiderDefaultPropertyValues\" : true, \"ConsiderNullOrEmptyPropertyValues\" : false, \"_bhomVersion\" : \"5.2\" }",
    Component="BH.oM.RDF.OntologySettings")

createcustom_3 = CreateCustom(
    Type="Roof",
    Materials=[createcustom, createcustom_2],
    Shape=conmesh,
    TestProperty="TestPropertyValue",
    Component="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")
explode = Explode(Object=createcustom_3, Component="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")  # -> Type, Materials, Shape, Name, Tags, BHoM_Guid
panel_2 = Panel(explode.Materials)
ttlgraph = TTLGraph(
    IObjects=createcustom_3,
    OntologySettings=ontologysettings,
    LocalRepositorySettings=localrepositorysettings,
    Component="{ .TTLGraph")
explode_2 = Explode(Object=explode.Shape, Component="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")  # -> Vertices, Faces
panel_3 = Panel(ttlgraph)
explode_3 = Explode(Object=explode_2.Vertices, Component="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")  # -> X, Y, Z
panel_4 = Panel(explode_3.X)
readttl = ReadTTL(TTLtext=panel_3, Component="{ .ReadTTL")
explode_4 = Explode(Object=readttl, Component="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")  # -> Type, TestProperty, Materials, Shape, Name, Tags, BHoM_Guid
explode_5 = Explode(Object=explode_4.Shape, Component="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")  # -> Vertices, Faces
panel_5 = Panel(explode_4.TestProperty)
panel_6 = Panel(explode_4.Materials)
explode_6 = Explode(Object=explode_5.Vertices, Component="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")  # -> X, Y, Z
explode_7 = Explode(Object=explode_2.Vertices, Component="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")  # -> X, Y, Z
panel_7 = Panel(explode_6.X)
panel_8 = Panel(explode_7.X)
